# Grasshopper definition NJ_rhino_python.gh (Grasshopper 1.0.7)

# #1 deconstruct points
pt = Point([Point(24.14886618, 17.24071, 0), Point(-52.18465387, 49.33317644, 0), Point(-387.1675687, -7.512190247, 0), Point(-124.0341545, -464.1603201, 0), Point(35.28257886, -102.6750532, 0), Point(-3.282904881, -18.88650788, 18.94849668)])
pdecon = Deconstruct(Point=pt)  # -> XComponent, YComponent, ZComponent
python = GhPythonScript(p=pt)  # -> X, Y, Z; inputs p: list
# ---------- python: Python ----------
__author__ = "ASUS"
__version__ = "2022.08.12"

import rhinoscriptsyntax as rs

xlist=[]
ylist=[]
zlist=[]


for i in p:
    pt=rs.PointCoordinates(i)
    xlist.append(pt[0])
    ylist.append(pt[1])
    zlist.append(pt[2])

X=xlist
Y=ylist
Z=zlist



#
#pt=rs.PointCoordinates(p[0])
#
#a=pt[0]
# ---------- end python ----------
panel = Panel(pt)
panel_2 = Panel(pdecon.YComponent)
panel_3 = Panel(pdecon.ZComponent)
panel_4 = Panel(pdecon.XComponent)
panel_5 = Panel(python.Z)
panel_6 = Panel(python.Y)
panel_7 = Panel(python.X)
pt_2 = ConstructPoint(XCoordinate=panel_4, YCoordinate=panel_2, ZCoordinate=panel_3)
# #2 series
number_slider = Slider(2, range=0..10)
series = Series(Start=number_slider, Step=Slider(4, range=0..10), Count=Slider(5, range=0..10))
number_slider_2 = Slider(4.786, range=0..10)
python_2 = GhPythonScript(S=Slider(2, range=0..10), N=Slider(4, range=0..10), C=Slider(5, range=0..10))  # -> out, a; inputs C: Int32
# ---------- python_2: Python ----------
__author__ = "ASUS"
__version__ = "2022.08.13"

import rhinoscriptsyntax as rs

mylist = []

for i in range(C):
    result = S+N*i
    mylist.append(result)
    

print(mylist)
# ---------- end python_2 ----------
pt_3 = ConstructPoint(
    XCoordinate=series,
    YCoordinate=[Slider(8.083, range=0..10), Slider(4.28, range=0..10), Slider(1.283, range=0..10)],
    ZCoordinate=Slider(4.786, range=0..10))
item = ListItem(List=pt_3, Index=Slider(0, range=0..100), Wrap=True)
pt_4 = ConstructPoint(
    XCoordinate=python_2.a,
    YCoordinate=[Slider(4, range=0..10), Slider(4.5, range=0..10), Slider(5, range=0..10), Slider(5.5, range=0..10)],
    ZCoordinate=Slider(0, range=0..100))
# #3 range& domain
dom = ConstructDomain(DomainStart=Slider(0, range=0..100), DomainEnd=Slider(20, range=0..100))
range = Range(Domain=dom, Steps=Slider(10, range=0..100))
python_3 = GhPythonScript(min=Slider(0, range=0..100), max=Slider(20, range=0..100), N=Slider(10, range=0..100))  # -> out, a; inputs N: Int32
# ---------- python_3: Python ----------
__author__ = "ASUS"
__version__ = "2022.08.17"

import rhinoscriptsyntax as rs

interval = (max-min)/N
mylist = []

for i in range(N):
    d= min+interval*i
    mylist.append(d)
    
a= mylist
# ---------- end python_3 ----------
domain = Domain()
panel_8 = Panel(python_3.a)
pt_5 = ConstructPoint(
    XCoordinate=range,
    YCoordinate=[Slider(5, range=0..10), Slider(6, range=0..10), Slider(7, range=0..10)],
    ZCoordinate=Slider(5, range=0..10))
panel_9 = Panel(range)
python_4 = GhPythonScript(X=python_3.a, Y=[Slider(5, range=0..10), Slider(6, range=0..10), Slider(7, range=0..10)], Z=Slider(5, range=0..10))  # -> out, b; inputs X: list, Y: list
# ---------- python_4: Python ----------
import rhinoscriptsyntax as rs
myPoint = []

for i in range(len(X)):
    if i< len(Y):
        pt1 = rs.AddPoint(X[i], Y[i], Z)
        myPoint.append(pt1)
        print(i)
        
    elif i > len(Y):
        print(i)

        
    else:
        pt2 = rs.AddPoint(X[i], Y[-1], Z)
        myPoint.append(pt2)


b =  myPoint
# ---------- end python_4 ----------
# #4-3 min, max있는 random
number_slider_3 = Slider(8, range=0..100)
# #4-1 도메인값 설정 안된 random
number_slider_4 = Slider(47, range=0..100)
실행 = Button()
실행_2 = Button()
# #4 random
random = Random(Range=Domain(0, 1), Number=Slider(47, range=0..100), Seed=Slider(5, range=0..10))
python_5 = GhPythonScript(min=number_slider_3, max=Slider(31, range=0..100), N=Slider(8, range=0..100), seed=Slider(5, range=0..10), BUTTON=실행)  # -> out, R
# ---------- python_5: Python ----------
__author__ = "ASUS"
__version__ = "2022.08.17"

import rhinoscriptsyntax as rs

#min+(max-min)*i
import random



R= min+(random.random())*(max-min)
# ---------- end python_5 ----------
python_6 = GhPythonScript(N=number_slider_4, seed=Slider(5, range=0..10), BUTTON=실행_2)  # -> out, R
# ---------- python_6: Python ----------
__author__ = "ASUS"
__version__ = "2022.08.17"

import rhinoscriptsyntax as rs


import random

R= random.random()
# ---------- end python_6 ----------
리셋 = Button()
리셋_2 = Button()
graph = QuickGraph(random, SortOrder=0)
panel_10 = Panel(random)
python_7 = GhPythonScript(reset=리셋)  # -> out, a
# ---------- python_7: Python ----------
import rhinoscriptsyntax as rs

class Data():
    data =[]

myData =Data

if(reset):
    myData=Data

a=myData
# ---------- end python_7 ----------
python_8 = GhPythonScript(reset=리셋_2)  # -> out, a; same code as python_7
panel_11 = Panel(python_6.R)
panel_12 = Panel(python_5.R)
rec = DataRecorder(python_5.R, DataLimit=-10, RecordData=True)
rec_2 = DataRecorder(python_6.R, DataLimit=-10, RecordData=True)
python_9 = GhPythonScript(d=python_5.R, DataObject=python_7.a)  # -> out, a, b, minV, maxV
# ---------- python_9: Python ----------
import rhinoscriptsyntax as rs

DataObject.data.append(d)
count =0 

for i in range(len(DataObject.data)):
    if DataObject.data[i] >0.5:
        count +=1

a = DataObject.data
b = count/len(DataObject.data)

minV=min(DataObject.data)
maxV=max(DataObject.data)
# ---------- end python_9 ----------
python_10 = GhPythonScript(d=python_6.R, DataObject=python_8.a)  # -> out, a, b
# ---------- python_10: Python ----------
import rhinoscriptsyntax as rs

DataObject.data.append(d)
count =0 

for i in range(len(DataObject.data)):
    if DataObject.data[i] >0.5:
        count +=1

a = DataObject.data
b = count/len(DataObject.data)
# ---------- end python_10 ----------
graph_2 = QuickGraph(rec, SortOrder=0)
graph_3 = QuickGraph(rec_2, SortOrder=0)
panel_13 = Panel(python_9.maxV)
panel_14 = Panel(python_10.b)
panel_15 = Panel(python_9.a)
panel_16 = Panel(python_10.a)
panel_17 = Panel(python_9.minV)
# #4-2 recorder값 파이썬으로 구현
graph_4 = QuickGraph(python_10.a, SortOrder=0)
graph_5 = QuickGraph(python_9.a, SortOrder=0)
panel_18 = Panel(python_9.b)
# #4-4 random 점으로 visualization
number_slider_5 = Slider(48, range=0..100)
# #4-4 random 점으로 visualization(python)
number_slider_6 = Slider(0, range=0..100)
실행_3 = Button()
random_2 = Random(Range=Domain(0, 1), Number=number_slider_5, Seed=1)
random_3 = Random(Range=Domain(0, 1), Number=number_slider_5, Seed=0)
random_4 = Random(Range=Domain(0, 1), Number=number_slider_5, Seed=2)
python_11 = GhPythonScript(min=number_slider_6, max=Slider(2, range=0..100), N=Slider(48, range=0..100), seed=Slider(2, range=0..10), BUTTON=실행_3)  # -> out, R; inputs N: Int32
# ---------- python_11: Python ----------
__author__ = "ASUS"
__version__ = "2022.08.17"

import rhinoscriptsyntax as rs
import random

list = []
for i in range(N):
    
    X= min+(random.random())*(max-min)
    Y= min+(random.random())*(max-min)
    Z= min+(random.random())*(max-min)
    p =rs.AddPoint(X,Y,Z)
    list.append(p)

R =list
# ---------- end python_11 ----------
pt_6 = ConstructPoint(XCoordinate=random_3, YCoordinate=random_2, ZCoordinate=random_4)
panel_19 = Panel(python_11.R)
